# Dynamo graph VT_CorrectionsToDynamo.dyn (Dynamo 0.9.0.3072)

# group: 0
# note: Vanilla

# group: 1
# note: Radial Array
# on XY Plane

# group: 2
# note: Radial Array
# on XZ Plane

# group: 3
# note: Radial Array
# on XZ Plane

# group: Representation of: Wobj O-frame (block)
code_block = CodeBlock { CoordinateSystem.ByOrigin(0,0,0); }

# group: Representation of: Block on end effector
code_block_2 = CodeBlock { 0.4; }
byLengths = Cuboid.ByLengths(code_block, code_block_2, code_block_2, code_block_2)

# group: Representation of: Wobj U-Frames (drill along z-axis)
code_block_3 = CodeBlock()
# ---------- code_block_3.designscript (5 lines) ----------
CoordinateSystem.ByPlane(
 Plane.ByOriginNormalXAxis(
 Point.ByCoordinates(0,0,0),
 Vector.ByCoordinates(-1,-2,-6),
 Vector.ByCoordinates(3,2,1)));
# ----------------------------------------
code_block_4 = CodeBlock()
# ---------- code_block_4.designscript (5 lines) ----------
CoordinateSystem.ByPlane(
 Plane.ByOriginNormalXAxis(
 Point.ByCoordinates(0,0,0),
 Vector.ByCoordinates(-1,7,-6),
 Vector.ByCoordinates(3,2,1)));
# ----------------------------------------
code_block_5 = CodeBlock()
# ---------- code_block_5.designscript (5 lines) ----------
CoordinateSystem.ByPlane(
 Plane.ByOriginNormalXAxis(
 Point.ByCoordinates(0,0,0),
 Vector.ByCoordinates(3,2,-6),
 Vector.ByCoordinates(3,6,3)));
# ----------------------------------------
code_block_6 = CodeBlock()
# ---------- code_block_6.designscript (5 lines) ----------
CoordinateSystem.ByPlane(
 Plane.ByOriginNormalXAxis(
 Point.ByCoordinates(0,0,0),
 Vector.ByCoordinates(3,2,-6),
 Vector.ByCoordinates(-3,-3,3)));
# ----------------------------------------

create = List.Create(code_block_3, code_block_4, code_block_5, code_block_6)

# group: Sample struts
origin = CoordinateSystem.Origin(create)
ZAxis = CoordinateSystem.ZAxis(create)
byStartPointDirectionLength = Line.ByStartPointDirectionLength(startPoint=origin, direction=ZAxis)

# group: Sample node
origin_2 = CoordinateSystem.Origin(code_block)

# group: Get struts that intersect with node and orient to point as necessary.
getLinesAtPoint = Dynamo_TORO.WIP_ROBARCH.getLinesAtPoint(byStartPointDirectionLength, origin_2)

planeAtParameter = Curve.PlaneAtParameter(curve=getLinesAtPoint)

# group: Reorient axes, here reversing and retaining the Z and X axes respectively.
flip_Plane = Dynamo_TORO.WIP_ROBARCH.flip_Plane(planeAtParameter)

directory_path = Directory("C:\Users\Nick Cote\Desktop\TORO\ClassLibrary1\ClassLibrary1\extra")
string = StringInput("test00")

# group: Check if planes are within drill cone.
testAngular_Plane = Dynamo_TORO.WIP_ROBARCH.testAngular_Plane(planeAtParameter)

# group: Sort planes by Z about pole
sortPolar_Plane = Dynamo_TORO.WIP_ROBARCH.sortPolar_Plane(testAngular_Plane)

code_block_7 = CodeBlock { Vector.ByCoordinates(1,0,0); }

# group: Align planes to guide XAxis
alignByXAxis_Plane = Dynamo_TORO.WIP_ROBARCH.alignByXAxis_Plane(sortPolar_Plane, code_block_7)

blockFrame = CodeBlock()
# ---------- blockFrame.designscript (3 lines) ----------
Plane.ByOriginNormal(
 Point.ByCoordinates(0,0,150),
 Vector.ByCoordinates(0,0,1));
# ----------------------------------------
drillFrame = CodeBlock()
# ---------- drillFrame.designscript (4 lines) ----------
Plane.ByOriginNormalXAxis(
 Point.ByCoordinates(300,-260,280),
 Vector.ByCoordinates(0,0,1),
 Vector.ByCoordinates(-1,0,0));
# ----------------------------------------

# group: Create drilling routine
createDrillRoutine3 = Dynamo_TORO.WIP_ROBARCH.createDrillRoutine3(directory_path, string, alignByXAxis_Plane, blockFrame, drillFrame)

code_block_8 = CodeBlock()
# ---------- code_block_8.designscript (14 lines) ----------
val = 0..359..45;
CoordinateSystem.ByPlane(
 Plane.ByOriginNormalXAxis(
 Point.ByCoordinates(0,0,0),
 Vector.ByCoordinates(
  Math.Cos(val),Math.Sin(val),0),
 Vector.ByCoordinates(0,0,-1)
 ));
CoordinateSystem.ByPlane(
 Plane.ByOriginNormalXAxis(
 Point.ByCoordinates(0,0,0),
 Vector.ByCoordinates(0,0,-1),
 Vector.ByCoordinates(1,0,0)
 ));
# ----------------------------------------
create_2 = List.Create(code_block_8.out1, code_block_8.out2)
flatten = Flatten(create_2)

# group: Sample struts
origin_3 = CoordinateSystem.Origin(flatten)
ZAxis_2 = CoordinateSystem.ZAxis(flatten)
byStartPointDirectionLength_2 = Line.ByStartPointDirectionLength(startPoint=origin_3, direction=ZAxis_2)

code_block_9 = CodeBlock { CoordinateSystem.ByOrigin(0,0,0); }

# group: Sample node
origin_4 = CoordinateSystem.Origin(code_block_9)

# group: Get struts that intersect with node and orient to point as necessary.
getLinesAtPoint_2 = Dynamo_TORO.WIP_ROBARCH.getLinesAtPoint(byStartPointDirectionLength_2, origin_4)

planeAtParameter_2 = Curve.PlaneAtParameter(curve=getLinesAtPoint_2)

# group: Reorient axes, here reversing and retaining the Z and X axes respectively.
flip_Plane_2 = Dynamo_TORO.WIP_ROBARCH.flip_Plane(planeAtParameter_2)

directory_path_2 = Directory("C:\Users\Nick Cote\Desktop\TORO\ClassLibrary1\ClassLibrary1\extra")
string_2 = StringInput("test01")

# group: Check if planes are within drill cone.
testAngular_Plane_2 = Dynamo_TORO.WIP_ROBARCH.testAngular_Plane(planeAtParameter_2)

# group: Sort planes by Z about pole
sortPolar_Plane_2 = Dynamo_TORO.WIP_ROBARCH.sortPolar_Plane(testAngular_Plane_2)

# group: Align planes to guide XAxis
alignByXAxis_Plane_2 = Dynamo_TORO.WIP_ROBARCH.alignByXAxis_Plane(sortPolar_Plane_2)

blockFrame_2 = CodeBlock()  # same code as blockFrame
drillFrame_2 = CodeBlock()  # same code as drillFrame

# group: Create drilling routine
createDrillRoutine3_2 = Dynamo_TORO.WIP_ROBARCH.createDrillRoutine3(directory_path_2, string_2, alignByXAxis_Plane_2, blockFrame_2, drillFrame_2)

directory_path_3 = Directory("C:\Users\Nick Cote\Desktop\TORO\ClassLibrary1\ClassLibrary1\extra")
string_3 = StringInput("test02")
code_block_10 = CodeBlock()
# ---------- code_block_10.designscript (7 lines) ----------
val = 90..270..10;
CoordinateSystem.ByPlane(
 Plane.ByOriginNormalXAxis(
 Point.ByCoordinates(0,0,0),
 Vector.ByCoordinates(Math.Cos(val),0,Math.Sin(val)),
 Vector.ByCoordinates(0,1,0)
 ));
# ----------------------------------------

# group: Sample struts
origin_5 = CoordinateSystem.Origin(code_block_10.out1)
ZAxis_3 = CoordinateSystem.ZAxis(code_block_10.out1)
byStartPointDirectionLength_3 = Line.ByStartPointDirectionLength(startPoint=origin_5, direction=ZAxis_3)

reverse = List.Reverse(byStartPointDirectionLength_3)
code_block_11 = CodeBlock { CoordinateSystem.ByOrigin(0,0,0); }

# group: Sample node
origin_6 = CoordinateSystem.Origin(code_block_11)

# group: Get struts that intersect with node and orient to point as necessary.
getLinesAtPoint_3 = Dynamo_TORO.WIP_ROBARCH.getLinesAtPoint(reverse, origin_6)

planeAtParameter_3 = Curve.PlaneAtParameter(curve=getLinesAtPoint_3)
code_block_12 = CodeBlock { 120; }

# group: Check if planes are within drill cone.
testAngular_Plane_3 = Dynamo_TORO.WIP_ROBARCH.testAngular_Plane(planeAtParameter_3, arg2=code_block_12)

# group: Sort planes by Z about pole
sortPolar_Plane_3 = Dynamo_TORO.WIP_ROBARCH.sortPolar_Plane(testAngular_Plane_3)

# group: Align planes to guide XAxis
alignByXAxis_Plane_3 = Dynamo_TORO.WIP_ROBARCH.alignByXAxis_Plane(sortPolar_Plane_3)

blockFrame_3 = CodeBlock()  # same code as blockFrame
drillFrame_3 = CodeBlock()  # same code as drillFrame

# group: Create drilling routine
createDrillRoutine3_3 = Dynamo_TORO.WIP_ROBARCH.createDrillRoutine3(directory_path_3, string_3, alignByXAxis_Plane_3, blockFrame_3, drillFrame_3)

# group: Reorient axes, here reversing and retaining the Z and X axes respectively.
flip_Plane_3 = Dynamo_TORO.WIP_ROBARCH.flip_Plane(planeAtParameter_3)

directory_path_4 = Directory("C:\Users\Nick Cote\Desktop\TORO\ClassLibrary1\ClassLibrary1\extra")
string_4 = StringInput("test03")
code_block_13 = CodeBlock()
# ---------- code_block_13.designscript (7 lines) ----------
val = 0..360..10;
CoordinateSystem.ByPlane(
 Plane.ByOriginNormalXAxis(
 Point.ByCoordinates(0,0,0),
 Vector.ByCoordinates(Math.Cos(val),0,Math.Sin(val)),
 Vector.ByCoordinates(0,1,0)
 ));
# ----------------------------------------

# group: Sample struts
origin_7 = CoordinateSystem.Origin(code_block_13.out1)
ZAxis_4 = CoordinateSystem.ZAxis(code_block_13.out1)
byStartPointDirectionLength_4 = Line.ByStartPointDirectionLength(startPoint=origin_7, direction=ZAxis_4)

code_block_14 = CodeBlock { CoordinateSystem.ByOrigin(0,0,0); }

# group: Sample node
origin_8 = CoordinateSystem.Origin(code_block_14)

# group: Get struts that intersect with node and orient to point as necessary.
getLinesAtPoint_4 = Dynamo_TORO.WIP_ROBARCH.getLinesAtPoint(byStartPointDirectionLength_4, origin_8)

planeAtParameter_4 = Curve.PlaneAtParameter(curve=getLinesAtPoint_4)
code_block_15 = CodeBlock { 120; }

# group: Check if planes are within drill cone.
testAngular_Plane_4 = Dynamo_TORO.WIP_ROBARCH.testAngular_Plane(planeAtParameter_4, arg2=code_block_15)

flatten_2 = Flatten(testAngular_Plane_4)
normal = Plane.Normal(flatten_2)
asPoint = Vector.AsPoint(normal)
pruneDuplicates = Point.PruneDuplicates(points=asPoint)
firstIndexOf = List.FirstIndexOf(list=asPoint, item=pruneDuplicates)
getItemAtIndex = List.GetItemAtIndex(list=flatten_2, index=firstIndexOf)
create_3 = List.Create(getItemAtIndex)
code_block_16 = CodeBlock { -4; }

# group: Sort planes by Z about average pole and shift values to best fit.
sortPolar2_Plane = Dynamo_TORO.WIP_ROBARCH.sortPolar2_Plane(create_3, code_block_16)

# group: Align planes to guide XAxis
alignByXAxis_Plane_4 = Dynamo_TORO.WIP_ROBARCH.alignByXAxis_Plane(sortPolar2_Plane)

blockFrame_4 = CodeBlock()  # same code as blockFrame
drillFrame_4 = CodeBlock()  # same code as drillFrame

# group: Create drilling routine
createDrillRoutine3_4 = Dynamo_TORO.WIP_ROBARCH.createDrillRoutine3(directory_path_4, string_4, alignByXAxis_Plane_4, blockFrame_4, drillFrame_4)

flatten_3 = Flatten(sortPolar2_Plane)
origin_9 = Plane.Origin(flatten_3)
normal_2 = Plane.Normal(flatten_3)
reverse_2 = Vector.Reverse(normal_2)
byStartPointDirectionLength_5 = Line.ByStartPointDirectionLength(startPoint=origin_9, direction=reverse_2)
integer_slider = IntegerSlider(21, range=0..22 step 1)
code_block_17 = CodeBlock(item=byStartPointDirectionLength_5, i=integer_slider) { item[i]; }
flatten_4 = Flatten(testAngular_Plane_4)
code_block_18 = CodeBlock { 1; }
testAngular2_Plane = Dynamo_TORO.WIP_ROBARCH.testAngular2_Plane(flatten_4, code_block_18)
code_block_19 = CodeBlock(a=testAngular2_Plane.out1) { a; }
