# Dynamo graph VT_CorrectionsToDynamo2.dyn (Dynamo 0.9.0.3072)

# group: 0
# note: Multi-radial
# array, varied

# group: Sample drill locations
code_block = CodeBlock()
# ---------- code_block.designscript (10 lines) ----------
CoordinateSystem.
 BySphericalCoordinates(
 CoordinateSystem.ByPlane(
  Plane.ByOriginNormalXAxis(
  Point.ByCoordinates(0,0,0),
  Vector.ByCoordinates(0,1,0),
  Vector.ByCoordinates(1,0,0)
  )), 0,
 0..360..30,
 0..360..30);
# ----------------------------------------

# group: Sample struts
origin = CoordinateSystem.Origin(code_block)
ZAxis = CoordinateSystem.ZAxis(code_block)
byStartPointDirectionLength = Line.ByStartPointDirectionLength(startPoint=origin, direction=ZAxis)

# group: Sample node origin
byCoordinates = Point.ByCoordinates()

# group: 1
getLinesAtPoint = Dynamo_TORO.WIP_ROBARCH.getLinesAtPoint(byStartPointDirectionLength, byCoordinates)

code_block_2 = CodeBlock { 29; }

# group: 2
getUnique_Plane = Dynamo_TORO.WIP_ROBARCH.getUnique_Plane(getLinesAtPoint.out1)

testAngular1_Plane = Dynamo_TORO.WIP_ROBARCH.testAngular1_Plane(getUnique_Plane)

# group (continued): 2
testAngular2_Plane = Dynamo_TORO.WIP_ROBARCH.testAngular2_Plane(testAngular1_Plane, code_block_2)

# group: 3
alignByXAxis_Plane = Dynamo_TORO.WIP_ROBARCH.alignByXAxis_Plane(testAngular2_Plane)
sortPolar2_Plane = Dynamo_TORO.WIP_ROBARCH.sortPolar2_Plane(alignByXAxis_Plane)

# group: Visualization
flatten = Flatten(sortPolar2_Plane)
origin_2 = Plane.Origin(flatten)
normal = Plane.Normal(flatten)
reverse = Vector.Reverse(normal)
code_block_3 = CodeBlock { 10; 100; 3; }
translate = Geometry.Translate(geometry=origin_2, direction=reverse, distance=code_block_3.out0)
translate_2 = Geometry.Translate(geometry=origin_2, direction=reverse, distance=code_block_3.out1)
byPointsRadius = Cylinder.ByPointsRadius(translate, translate_2, code_block_3.out2)

code_block_4 = CodeBlock { 40; }
byLengths = Cuboid.ByLengths(width=code_block_4, length=code_block_4, height=code_block_4)
edges = Topology.Edges(byLengths)
curveGeometry = Edge.CurveGeometry(edges)
blockFrame = CodeBlock()
# ---------- blockFrame.designscript (3 lines) ----------
Plane.ByOriginNormal(
 Point.ByCoordinates(0,0,150),
 Vector.ByCoordinates(0,0,1));
# ----------------------------------------
drillFrame = CodeBlock()
# ---------- drillFrame.designscript (4 lines) ----------
Plane.ByOriginNormalXAxis(
 Point.ByCoordinates(300,-260,280),
 Vector.ByCoordinates(0,0,1),
 Vector.ByCoordinates(-1,0,0));
# ----------------------------------------
number_slider = DoubleSlider(4, range=0..10 step 1)
vis_transform2 = Dynamo_TORO.WIP_ROBARCH.vis_transform2(alignByXAxis_Plane, blockFrame, drillFrame, arg4=number_slider)
directory_path = Directory("C:\Users\Nick Cote\Desktop\TORO\ClassLibrary1\ClassLibrary1\extra")
string = StringInput("test06")
createDrillRoutine2 = Dynamo_TORO.WIP_ROBARCH.createDrillRoutine2(directory_path, string, alignByXAxis_Plane)
