# Dynamo graph example02.dyn (Dynamo 0.9.1.4054)

directory_path = Directory("C:\Users\Nick Cote\Desktop\TORO\ClassLibrary1\ClassLibrary1\extra\directory")
code_block = CodeBlock { 400; }
byLengths = Cuboid.ByLengths(width=code_block, length=code_block, height=code_block)
edges = Face.Edges(byLengths)
curveGeometry = Edge.CurveGeometry(edges)
endPoint = Curve.EndPoint(curveGeometry)
startPoint = Curve.StartPoint(curveGeometry)
byStartPointEndPoint = Line.ByStartPointEndPoint(startPoint=endPoint, endPoint=startPoint)
code_block_2 = CodeBlock { 40; }
byLengths_2 = Cuboid.ByLengths(width=code_block_2, length=code_block_2, height=code_block_2)
byPointsLinesGeometries = WireFrameToRobot.Node.ByPointsLinesGeometries(endPoint, byStartPointEndPoint, byLengths_2)
testAngular1_Node = Dynamo_TORO.WIP_ROBARCH.testAngular1_Node(byPointsLinesGeometries)
testAngular2_Node = Dynamo_TORO.WIP_ROBARCH.testAngular2_Node(testAngular1_Node)
createDrillRoutine3 = Dynamo_TORO.WIP_ROBARCH.createDrillRoutine3(directory_path, testAngular2_Node)
directory_path_2 = Directory("C:\Users\Nick Cote\Desktop\TORO\ClassLibrary1\ClassLibrary1\extra\directory")
getUnique_Point = Dynamo_TORO.WIP_ROBARCH.getUnique_Point(endPoint)
getLinesPlaneAtPoint = Dynamo_TORO.WIP_ROBARCH.getLinesPlaneAtPoint(byStartPointEndPoint, getUnique_Point)
code_block_3 = CodeBlock()
# ---------- code_block_3.designscript (3 lines) ----------
Plane.ByOriginNormal(
 Point.ByCoordinates(0,0,0),
 Vector.ByCoordinates(0,0,-1));
# ----------------------------------------
transform_Plane = Dynamo_TORO.WIP_ROBARCH.transform_Plane(getLinesPlaneAtPoint.out1, code_block_3)
testAngular1_Plane = Dynamo_TORO.WIP_ROBARCH.testAngular1_Plane(transform_Plane, lacing=Longest)
testAngular2_Plane = Dynamo_TORO.WIP_ROBARCH.testAngular2_Plane(testAngular1_Plane)
code_block_4 = CodeBlock(p=testAngular2_Plane)
# ---------- code_block_4.designscript (4 lines) ----------
t0 = Plane.ByOriginNormalXAxis(
 p.Origin, Vector.XAxis(), p.Normal);
t1 = Plane.ByOriginNormalXAxis(
 t0.Origin, t0.XAxis, t0.Normal);
# ----------------------------------------
number_slider = DoubleSlider(-1, range=-1..1 step 0.01)
alignByXAxis_Plane = Dynamo_TORO.WIP_ROBARCH.alignByXAxis_Plane(code_block_4.t1, arg2=number_slider)
createDrillRoutine2 = Dynamo_TORO.WIP_ROBARCH.createDrillRoutine2(directory_path_2, arg2=alignByXAxis_Plane)
byPlane = CoordinateSystem.ByPlane(alignByXAxis_Plane)
byPlane_2 = CoordinateSystem.ByPlane(code_block_4.t1)
