# Dynamo graph CoolingTowerPavilion.dyn (Dynamo 0.9.1.4062)

file_path = Filename("C:\Users\Mike\Desktop\au2015sat.sat")
importFromSAT = Geometry.ImportFromSAT(file_path)
code_block = CodeBlock { 888; }
scale = Geometry.Scale(geometry=importFromSAT, amount=code_block)
byGeometry = BoundingBox.ByGeometry(scale)
toCuboid = BoundingBox.ToCuboid(byGeometry)
flatten = Flatten()
code_block_2 = CodeBlock { 1200; }
code_block_3 = CodeBlock(base=code_block_2) { baseh = base; bottomRing = 0; midh = baseh + base; toph = midh +baseh; }
byCoordinates = Point.ByCoordinates(z=code_block_3.bottomRing)
code_block_4 = CodeBlock(base=code_block_2) { bottomRing = base * 1.5; mid = base / 1.2; top = mid * 1.1; }
byCenterPointRadius = Circle.ByCenterPointRadius(centerPoint=byCoordinates, radius=code_block_4.bottomRing)
byCoordinates_2 = Point.ByCoordinates(z=code_block_3.baseh)
byCenterPointRadius_2 = Circle.ByCenterPointRadius(centerPoint=byCoordinates_2, radius=code_block_2)
byCoordinates_3 = Point.ByCoordinates(z=code_block_3.midh)
byCenterPointRadius_3 = Circle.ByCenterPointRadius(centerPoint=byCoordinates_3, radius=code_block_4.mid)
byCoordinates_4 = Point.ByCoordinates(z=code_block_3.toph)
byCenterPointRadius_4 = Circle.ByCenterPointRadius(centerPoint=byCoordinates_4, radius=code_block_4.top)
create = List.Create(byCenterPointRadius, byCenterPointRadius_2, byCenterPointRadius_3, byCenterPointRadius_4)
byLoft = Surface.ByLoft(create)
boundingBox = Geometry.BoundingBox(byLoft)
toCuboid_2 = BoundingBox.ToCuboid(boundingBox)
code_block_5 = CodeBlock { 18; }
lunchbox_triangle_grid_by_face = Custom[LunchBox Triangle Grid by Face](Surface=byLoft, U=code_block_5, V=code_block_5)  # Create a Triangular XYZ grid on a face. The face surface must have an untrimmed UV parameter space.
code_block_6 = CodeBlock(lines=lunchbox_triangle_grid_by_face.Panel_Polys) { lines; }
explode = Geometry.Explode(code_block_6)
flatten_2 = Flatten(explode)
startPoint = Curve.StartPoint(flatten_2)
endPoint = Curve.EndPoint(flatten_2)
byStartPointEndPoint = Line.ByStartPointEndPoint(startPoint=startPoint, endPoint=endPoint)
code_block_7 = CodeBlock { 6; }
code_block_8 = CodeBlock { 20; }
byLengths = Cuboid.ByLengths(width=code_block_8, length=code_block_8, height=code_block_8)
averageStrutsVector = WireFrameToRobot.OrientationStrategy.AverageStrutsVector()
byPointsLinesAndGeoOrientationStrategy = WireFrameToRobot.Node.ByPointsLinesAndGeoOrientationStrategy(startPoint, byStartPointEndPoint, code_block_7, byLengths, averageStrutsVector)
findUniqueStruts = WireFrameToRobot.Node.FindUniqueStruts(byPointsLinesAndGeoOrientationStrategy)
lineRepresentation = WireFrameToRobot.Strut.LineRepresentation(findUniqueStruts)
length = Curve.Length(lineRepresentation)
maximumItem = List.MaximumItem(length)
findNodeTypes = WireFrameToRobot.Node.FindNodeTypes()
