# Dynamo graph FindingNodeTypes.dyn (Dynamo 0.9.1.4062)

file_path = Filename("C:\Users\Mike\Desktop\au2015sat.sat")
importFromSAT = Geometry.ImportFromSAT(file_path)
code_block = CodeBlock { 888; }
scale = Geometry.Scale(geometry=importFromSAT, amount=code_block)
byGeometry = BoundingBox.ByGeometry(scale)
toCuboid = BoundingBox.ToCuboid(byGeometry)
code_block_2 = CodeBlock { 100; }
byLengths = Cuboid.ByLengths(width=code_block_2, length=code_block_2, height=code_block_2)
explode = Geometry.Explode(byLengths)
code_block_3 = CodeBlock(a=explode) { a[0]; }
code_block_4 = CodeBlock { 10; }
lunchbox_triangle_grid_by_face = Custom[LunchBox Triangle Grid by Face](Surface=code_block_3, U=code_block_4, V=code_block_4)  # Create a Triangular XYZ grid on a face. The face surface must have an untrimmed UV parameter space.
code_block_5 = CodeBlock(lines=lunchbox_triangle_grid_by_face.Panel_Polys) { lines; }
explode_2 = Geometry.Explode(code_block_5)
flatten = Flatten(explode_2)
startPoint = Curve.StartPoint(flatten)
endPoint = Curve.EndPoint(flatten)
byStartPointEndPoint = Line.ByStartPointEndPoint(startPoint=startPoint, endPoint=endPoint)
code_block_6 = CodeBlock { 6; }
code_block_7 = CodeBlock { 20; }
byLengths_2 = Cuboid.ByLengths(width=code_block_7, length=code_block_7, height=code_block_7)
averageStrutsVector = WireFrameToRobot.OrientationStrategy.AverageStrutsVector()
byPointsLinesAndGeoOrientationStrategy = WireFrameToRobot.Node.ByPointsLinesAndGeoOrientationStrategy(startPoint, byStartPointEndPoint, code_block_6, byLengths_2, averageStrutsVector)
findNodeTypes = WireFrameToRobot.Node.FindNodeTypes(byPointsLinesAndGeoOrientationStrategy)
struts = WireFrameToRobot.Node.Struts(byPointsLinesAndGeoOrientationStrategy)
transformedCutPlane = WireFrameToRobot.Strut.TransformedCutPlane(struts)
holderRep = WireFrameToRobot.Node.holderRep(byPointsLinesAndGeoOrientationStrategy)
orientedNodeGeometry = WireFrameToRobot.Node.OrientedNodeGeometry(byPointsLinesAndGeoOrientationStrategy)
