# Dynamo graph pavDesigns22.dyn (Dynamo 0.9.1.4062)

number = DoubleInput(1000)
code_block = CodeBlock { -3000; }
byCoordinates = Point.ByCoordinates(x=number, y=code_block)
byCoordinates_2 = Point.ByCoordinates(y=code_block)
byStartPointEndPoint = Line.ByStartPointEndPoint(startPoint=byCoordinates, endPoint=byCoordinates_2)
code_block_2 = CodeBlock { 2000; }
translate = Geometry.Translate(geometry=byStartPointEndPoint, yTranslation=code_block_2)
create = List.Create(byStartPointEndPoint, translate)
code_block_3 = CodeBlock { -2000; }
translate_2 = Geometry.Translate(geometry=create, xTranslation=code_block_3)
byLoft = Surface.ByLoft(translate_2)
code_block_4 = CodeBlock(a=translate_2) { a[1]; }
endPoint = Curve.EndPoint(code_block_4)
code_block_5 = CodeBlock { 300; }
translate_3 = Geometry.Translate(geometry=endPoint, yTranslation=code_block_5, zTranslation=code_block_5)
YAxis = Vector.YAxis()
byStartPointEndPointStartTangent = Arc.ByStartPointEndPointStartTangent(endPoint, translate_3, YAxis)
extrude = Curve.Extrude(curve=byStartPointEndPointStartTangent, distance=number)
translate_4 = Geometry.Translate(geometry=translate_3, yTranslation=code_block_5, zTranslation=code_block_5)
code_block_6 = CodeBlock { 1; }
coordinateSystemAtParameter = Curve.CoordinateSystemAtParameter(byStartPointEndPointStartTangent, code_block_6)
YAxis_2 = CoordinateSystem.YAxis(coordinateSystemAtParameter)
byStartPointEndPointStartTangent_2 = Arc.ByStartPointEndPointStartTangent(translate_3, translate_4, YAxis_2)
code_block_7 = CodeBlock(x=number) { x*-1; }
extrude_2 = Curve.Extrude(curve=byStartPointEndPointStartTangent_2, distance=code_block_7)
flipNormalDirection = Surface.FlipNormalDirection(extrude_2)
create_2 = List.Create(byLoft, extrude, flipNormalDirection)
code_block_8 = CodeBlock { 3; }
code_block_9 = CodeBlock { 100; }
lunchbox_space_truss_structure = Custom[LunchBox Space Truss Structure](Surface=create_2, U=code_block_8, V=code_block_8, Depth=code_block_9)  # Create a space truss using a surface.
code_block_10 = CodeBlock(diagonals=lunchbox_space_truss_structure.CenterlinesE) { diagonals; }
code_block_11 = CodeBlock(topedgesY=lunchbox_space_truss_structure.CenterlinesB) { topedgesY; }
code_block_12 = CodeBlock(topedgesX=lunchbox_space_truss_structure.CenterlinesA) { topedgesX; }
code_block_13 = CodeBlock { 4; }
generateSide = Custom[generateSide](divisions=code_block_13, Verticaldivisions=code_block_13)  # test
code_block_14 = CodeBlock { -35; }
rotateAndTranslate = Custom[rotateAndTranslate](geometry=generateSide.PolyCurve, xTranslation=generateSide.x_translation, oldgeometry=generateSide.PolyCurve, divisions=code_block_13, Verticaldivisions=code_block_13, angle=code_block_14)  # rotate a parallelgram and translate
rotateAndTranslate_2 = Custom[rotateAndTranslate](geometry=rotateAndTranslate.Geometry, xTranslation=generateSide.x_translation, oldgeometry=generateSide.PolyCurve, divisions=code_block_13, Verticaldivisions=code_block_13, angle=code_block_14)
rotateAndTranslate_3 = Custom[rotateAndTranslate](geometry=rotateAndTranslate_2.Geometry, xTranslation=generateSide.x_translation, oldgeometry=generateSide.PolyCurve, divisions=code_block_13, Verticaldivisions=code_block_13, angle=code_block_14)
rotateAndTranslate_4 = Custom[rotateAndTranslate](geometry=rotateAndTranslate_3.Geometry, xTranslation=generateSide.x_translation, oldgeometry=generateSide.PolyCurve, divisions=code_block_13, Verticaldivisions=code_block_13, angle=code_block_14)
rotateAndTranslate_5 = Custom[rotateAndTranslate](geometry=rotateAndTranslate_4.Geometry, xTranslation=generateSide.x_translation, oldgeometry=generateSide.PolyCurve, divisions=code_block_13, Verticaldivisions=code_block_13, angle=code_block_14)
rotateAndTranslate_6 = Custom[rotateAndTranslate](geometry=rotateAndTranslate_5.Geometry, xTranslation=generateSide.x_translation, oldgeometry=generateSide.PolyCurve, divisions=code_block_13, Verticaldivisions=code_block_13, angle=code_block_14)
rotateAndTranslate_7 = Custom[rotateAndTranslate](geometry=rotateAndTranslate_6.Geometry, xTranslation=generateSide.x_translation, oldgeometry=generateSide.PolyCurve, divisions=code_block_13, Verticaldivisions=code_block_13, angle=code_block_14)
rotateAndTranslate_8 = Custom[rotateAndTranslate](geometry=rotateAndTranslate_7.Geometry, xTranslation=generateSide.x_translation, oldgeometry=generateSide.PolyCurve, divisions=code_block_13, Verticaldivisions=code_block_13, angle=code_block_14)
rotateAndTranslate_9 = Custom[rotateAndTranslate](geometry=rotateAndTranslate_8.Geometry, xTranslation=generateSide.x_translation, oldgeometry=generateSide.PolyCurve, divisions=code_block_13, Verticaldivisions=code_block_13, angle=code_block_14)
code_block_15 = CodeBlock { Autodesk.Point.ByCoordinates(0,20,0); Autodesk.Point.ByCoordinates(0,23,5); Autodesk.Point.ByCoordinates(0,20,15); }
byThreePoints = Arc.ByThreePoints(firstPoint=code_block_15.out0, secondPoint=code_block_15.out1, thirdPoint=code_block_15.out2)
code_block_16 = CodeBlock { Autodesk.Point.ByCoordinates(0,20,15); Autodesk.Point.ByCoordinates(0,15,20); Autodesk.Point.ByCoordinates(0,17,25); }
byThreePoints_2 = Arc.ByThreePoints(firstPoint=code_block_16.out0, secondPoint=code_block_16.out1, thirdPoint=code_block_16.out2)
code_block_17 = CodeBlock(a=byThreePoints, b=byThreePoints_2) { {a,b}; }
code_block_18 = CodeBlock { 0..1..#6; }
pointAtParameter = Curve.PointAtParameter(curve=code_block_17, param=code_block_18, lacing=CrossProduct)
flatten = Flatten(pointAtParameter)
byPoints = NurbsCurve.ByPoints(flatten)
code_block_19 = CodeBlock { 360; }
byRevolve = Surface.ByRevolve(byPoints, arg4=code_block_19)
code_block_20 = CodeBlock { 10; }
scale = Geometry.Scale(geometry=byRevolve, amount=code_block_20)
XY = Plane.XY()
mirror = Geometry.Mirror(geometry=scale, mirrorPlane=XY)
code_block_21 = CodeBlock { 10; }
lunchbox_quad_grid_by_face = Custom[LunchBox Quad Grid by Face](Surface=mirror, U=code_block_21, V=code_block_21)  # Create a quadrangular XYZ grid on a face. The face surface must have an untrimmed UV parameter space.
code_block_22 = CodeBlock { lines; }
explode = Geometry.Explode(code_block_22)
flatten_2 = Flatten(explode)
startPoint = Curve.StartPoint(flatten_2)
endPoint_2 = Curve.EndPoint(flatten_2)
byStartPointEndPoint_2 = Line.ByStartPointEndPoint(startPoint=startPoint, endPoint=endPoint_2)
code_block_23 = CodeBlock { 6; }
code_block_24 = CodeBlock { 20; }
byLengths = Cuboid.ByLengths(width=code_block_24, length=code_block_24, height=code_block_24)
averageStrutsVector = WireFrameToRobot.OrientationStrategy.AverageStrutsVector()
byPointsLinesAndGeoOrientationStrategy = WireFrameToRobot.Node.ByPointsLinesAndGeoOrientationStrategy(startPoint, byStartPointEndPoint_2, code_block_23, byLengths, averageStrutsVector)
nodeGeometry = WireFrameToRobot.Node.NodeGeometry(byPointsLinesAndGeoOrientationStrategy)
code_block_25 = CodeBlock { 30; }
getLabels = WireFrameToRobot.ILabelAble.GetLabels(byPointsLinesAndGeoOrientationStrategy, code_block_25)
struts = WireFrameToRobot.Node.Struts(byPointsLinesAndGeoOrientationStrategy)
strutGeometry = WireFrameToRobot.Strut.StrutGeometry(struts)
code_block_26 = CodeBlock { 200; 500; }
translate_5 = Geometry.Translate(geometry=translate, yTranslation=code_block_26.out0, zTranslation=code_block_26.out1)
code_block_27 = CodeBlock { 200; 400; }
translate_6 = Geometry.Translate(geometry=translate_5, yTranslation=code_block_27.out1, zTranslation=code_block_27.out0)
create_3 = List.Create(byStartPointEndPoint, translate, translate_5, translate_6)
byLoft_2 = Surface.ByLoft(create_3)
code_block_28 = CodeBlock { 5; }
code_block_29 = CodeBlock { 100; }
lunchbox_space_truss_structure_2 = Custom[LunchBox Space Truss Structure](Surface=byLoft_2, U=code_block_28, V=code_block_28, Depth=code_block_29)
code_block_30 = CodeBlock(topedgesX=lunchbox_space_truss_structure_2.CenterlinesA) { topedgesX; }
code_block_31 = CodeBlock(topedgesY=lunchbox_space_truss_structure_2.CenterlinesB) { topedgesY; }
code_block_32 = CodeBlock(diagonals=lunchbox_space_truss_structure_2.CenterlinesE) { diagonals; }
code_block_33 = CodeBlock(x=code_block_30, y=code_block_31, z=code_block_32) { {x,y,z}; }
flatten_3 = Flatten(code_block_33)
startPoint_2 = Curve.StartPoint(flatten_3)
endPoint_3 = Curve.EndPoint(flatten_3)
join = List.Join(startPoint_2, endPoint_3)
code_block_34 = CodeBlock { 6; }
code_block_35 = CodeBlock { 20; }
byLengths_2 = Cuboid.ByLengths(width=code_block_35, length=code_block_35, height=code_block_35)
averageStrutsVector_2 = WireFrameToRobot.OrientationStrategy.AverageStrutsVector()
byPointsLinesAndGeoOrientationStrategy_2 = WireFrameToRobot.Node.ByPointsLinesAndGeoOrientationStrategy(join, flatten_3, code_block_34, byLengths_2, averageStrutsVector_2)
nodeGeometry_2 = WireFrameToRobot.Node.NodeGeometry(byPointsLinesAndGeoOrientationStrategy_2)
code_block_36 = CodeBlock { 60; }
getLabels_2 = WireFrameToRobot.ILabelAble.GetLabels(byPointsLinesAndGeoOrientationStrategy_2, code_block_36)
struts_2 = WireFrameToRobot.Node.Struts(byPointsLinesAndGeoOrientationStrategy_2)
strutGeometry_2 = WireFrameToRobot.Strut.StrutGeometry(struts_2)
