# Dynamo graph paviliondesignAuBaseSurface.dyn (Dynamo 0.9.1.4062)

file_path = Filename("C:\Users\Mike\Desktop\au2015sat.sat")
importFromSAT = Geometry.ImportFromSAT(file_path)
code_block = CodeBlock { 888; }
scale = Geometry.Scale(geometry=importFromSAT, amount=code_block)
byGeometry = BoundingBox.ByGeometry(scale)
toCuboid = BoundingBox.ToCuboid(byGeometry)
code_block_2 = CodeBlock { 18; }
lunchbox_triangle_grid_by_face = Custom[LunchBox Triangle Grid by Face](Surface=scale, U=code_block_2, V=code_block_2)  # Create a Triangular XYZ grid on a face. The face surface must have an untrimmed UV parameter space.
code_block_3 = CodeBlock(lines=lunchbox_triangle_grid_by_face.Panel_Polys) { lines; }
explode = Geometry.Explode(code_block_3)
flatten = Flatten(explode)
startPoint = Curve.StartPoint(flatten)
endPoint = Curve.EndPoint(flatten)
byStartPointEndPoint = Line.ByStartPointEndPoint(startPoint=startPoint, endPoint=endPoint)
code_block_4 = CodeBlock { 6; }
code_block_5 = CodeBlock { 20; }
byLengths = Cuboid.ByLengths(width=code_block_5, length=code_block_5, height=code_block_5)
averageStrutsVector = WireFrameToRobot.OrientationStrategy.AverageStrutsVector()
byPointsLinesAndGeoOrientationStrategy = WireFrameToRobot.Node.ByPointsLinesAndGeoOrientationStrategy(startPoint, byStartPointEndPoint, code_block_4, byLengths, averageStrutsVector)
findUniqueStruts = WireFrameToRobot.Node.FindUniqueStruts(byPointsLinesAndGeoOrientationStrategy)
orientedNodeGeometry = WireFrameToRobot.Node.OrientedNodeGeometry(byPointsLinesAndGeoOrientationStrategy)
struts = WireFrameToRobot.Node.Struts(byPointsLinesAndGeoOrientationStrategy)
strutGeometry = WireFrameToRobot.Strut.StrutGeometry(struts)
lineRepresentation = WireFrameToRobot.Strut.LineRepresentation(struts)
flatten_2 = Flatten(lineRepresentation)
length = Curve.Length(flatten_2)
maximumItem = List.MaximumItem(length)
totalStrutLength = WireFrameToRobot.Node.TotalStrutLength(byPointsLinesAndGeoOrientationStrategy)
