# Dynamo graph ApplyingFunctionsBasics.dyn (Dynamo 1.0.0.526)

# group: This will replaced with struts
code_block = CodeBlock { 0..200; }

# group: These are our evaluations functions, they can be written in c#, nodes, or designScript, they should accept a Strut, and return a bool.
code_block_2 = CodeBlock { 10; }
lt = _ < code_block_2
code_block_3 = CodeBlock { 2; }
gt = _ > code_block_3
code_block_4 = CodeBlock { 100; }
lt_2 = _ < code_block_4

create = List.Create(lt, gt, lt_2)

# group: we apply all the functions and check that all functions passed for each input, then we filter based on all passing or not. - We can think of this in english as: if a strut passed all the tests it passes then entire evaluation, if it fails any then it fails all. This is a logical AND over the entire set of functions.
apply = ApplyFunction(create, code_block)  # "Function.Apply"
transpose = List.Transpose(apply)
allTrue = AllTrue()
map = List.Map(list=transpose, f_x=allTrue)

filterByBoolMask = List.FilterByBoolMask(list=code_block, mask=map)
